# Grasshopper definition llm_requests_windows.gh (Grasshopper 1.0.8)
# plug-ins: Bifocals, ShapeDiverForGrasshopper

sddp = ShapeDiverDocumentPayload({AbsoluteTolerance=0, AngleTolerance=0, DistanceDisplayPrecision=0, GltfVersion="Gltf2", GrasshopperVersion="1.0.0008", InputGroups="{}", OutputGroups="{}", RelativeTolerance=0, RhinoVersion="8.19.25132.1001", UnitSystem=0, VersionCreated="1.26.0.0", VersionSaved="1.26.0.0"})
panel = Panel("how do i bake cookies?")  # disabled
py3 = Python3Script(input_text=panel, run=Toggle(False))  # -> out, out_2; disabled
# ---------- py3: Python ----------
#r: requests

import requests

url = 'http://localhost:5000/llm_call'
payload = {'input': input_text}


out = None
if run:
    response = requests.post(url, json=payload)

    if response.status_code == 200:
        data = response.json()
        out = data['response']
    else:
        out = "Failed to connect:"

a = out
# ---------- end py3 ----------
panel_2 = Panel("san diego, california")  # disabled
toggle = BooleanToggle(False)  # disabled
panel_3 = Panel(py3.out_2)  # disabled
number_slider = Slider(2, range=0..10)  # disabled
number_slider_2 = Slider(10, range=0..10)  # disabled
py3_2 = Python3Script(input_text=panel_2, run=toggle)  # -> out, min_range, max_range, description; disabled
# ---------- py3_2: Python ----------
#r: requests

import requests

url = 'http://localhost:5000/llm_call'
payload = {'input': input_text}


out = None
if run:
    response = requests.post(url, json=payload)

    if response.status_code == 200:
        data = response.json()
        out = data['response']
    else:
        out = "Failed to connect:"


print(out)
# ---------- end py3_2 ----------
panel_4 = Panel("new york")  # disabled
toggle_2 = BooleanToggle(False)  # disabled
panel_5 = Panel(py3_2.description)
python_3_script = Python3Script(input_text=panel_4, run=toggle_2)  # -> out, points; disabled
# ---------- python_3_script: Python ----------
#r: requests

import requests
from ghpythonlib.treehelpers import list_to_tree

url = 'http://localhost:5000/llm_call'
payload = {'input': input_text}


out = None
if run:
    response = requests.post(url, json=payload)

    if response.status_code == 200:
        data = response.json()
        out = data['response']
    else:
        out = "Failed to connect:"

try:
    print(out)
    text = out.splitlines()
    point1 = []
    for t in text:
        t = t.replace("[","")
        t = t.replace("]","")
        print(t)
        x, y = t.split(",")
        point1.append([x,y])

    points = list_to_tree(point1)
except Exception as e:
    # simple print
    print("Caught exception:", e)
    print("Incorrect format")
# ---------- end python_3_script ----------
panel_6 = Panel(py3_2.out)
panel_7 = Panel(py3_2.max_range)
panel_8 = Panel(py3_2.min_range)
number = Number(python_3_script.points)
panel_9 = Panel(number)
list_item = ListItem(List=panel_9, Index=0, Wrap=True)  # -> Item, Item1
number_slider_3 = Slider(3, range=0..10)
construct_point = ConstructPoint(XCoordinate=list_item.Item, YCoordinate=list_item.Item1, ZCoordinate=0)  # -> flatten(Point)
rectangle = Rectangle(Plane=PlaneXY(0, 0, 0), XSize=number_slider_3, YSize=number_slider_3, Radius=0)  # -> Rectangle, Length
list_item_2 = ListItem(List=construct_point, Index=0, Wrap=True)  # -> Item, Item1
rectangle_2pt = Rectangle2Pt(Plane=PlaneXY(0, 0, 0), PointA=list_item_2.Item, PointB=list_item_2.Item1, Radius=0)  # -> Rectangle, Length
curve = Curve(rectangle.Rectangle)
boundary_surfaces = BoundarySurfaces(Edges=curve)
curve_2 = Curve(rectangle_2pt.Rectangle)
boundary_surfaces_2 = BoundarySurfaces(Edges=curve_2)

location_of_window = MDSlider(SliderMode=0, slider_value=Point(1, 0, 0.5), x_domain=Domain(0, 1), y_domain=Domain(0, 1), z_domain=Domain(0, 1))
corner_move = Slider(2.2, range=0..10)
gene_pool = GenePool(Decimals=2, Maximum=1, Minimum=0, Value=[0, 0, 0.56, 0])

data_recorder = DataRecorder(boundary_surfaces_2, DataLimit=-10, RecordData=True)
offset_curve = OffsetCurve(Curve=boundary_surfaces, Distance=Slider(-0.2, range=-0.2..2), Corners=1)
surface = Surface(data_recorder)
evaluate_surface = EvaluateSurface(Surface=reparameterize(offset_curve), Point=location_of_window)  # -> Point, Normal, UDirection, VDirection, Frame
unit_z = UnitZ(Factor=1)
list_item_3 = ListItem(List=surface, Index=number_slider, Wrap=True)
region_difference = RegionDifference(CurvesA=boundary_surfaces, CurvesB=list_item_3)
brep_edges = BrepEdges(Brep=boundary_surfaces)  # -> Naked, Interior, NonManifold
move = Move(Geometry=list_item_3, Motion=unit_z)  # -> Geometry, Transform
brep_edges_2 = BrepEdges(Brep=move.Geometry)  # -> Naked, Interior, NonManifold
point = Point(evaluate_surface.Point)
join_curves = JoinCurves(Curves=brep_edges_2.Naked, Preserve=False)
join_curves_2 = JoinCurves(Curves=brep_edges.Naked, Preserve=False)
custom_preview = CustomPreview(Geometry=list_item_3, Material=ColourSwatch(SwatchColor=RGB(156, 219, 255)))
panel_10 = Panel(data_recorder)
panel_11 = Panel(point)
boundary_surfaces_3 = BoundarySurfaces(Edges=region_difference)
area = Area(Geometry=join_curves_2)  # -> Area, Centroid
discontinuity = Discontinuity(Curve=join_curves, Level=1)  # -> Points, Parameters
discontinuity_2 = Discontinuity(Curve=join_curves_2, Level=1)  # -> Points, Parameters
custom_preview_2 = CustomPreview(Geometry=boundary_surfaces_3, Material=ColourSwatch(SwatchColor=RGB(255, 255, 255)))
circle = Circle(Plane=area.Centroid, Radius=1)
area_2 = Area(Geometry=list_item_3)  # -> Area, Centroid
area_3 = Area(Geometry=boundary_surfaces)  # -> Area, Centroid
unit_x = UnitX(Factor=Slider(2, range=0..10))
vector_xyz = VectorXYZ(XComponent=corner_move, YComponent=corner_move, ZComponent=0)  # -> Vector, Length
curve_closest_point = CurveClosestPoint(Point=discontinuity.Points, Curve=circle)  # -> Point, Parameter, Distance
curve_closest_point_2 = CurveClosestPoint(Point=discontinuity_2.Points, Curve=circle)  # -> Point, Parameter, Distance
move_2 = Move(Geometry=area_2.Centroid, Motion=unit_x)  # -> Geometry, Transform
move_3 = Move(Geometry=point, Motion=vector_xyz.Vector)  # -> Geometry, Transform
division = Division(A=area_2.Area, B=area_3.Area)
sort_list = SortList(Keys=curve_closest_point_2.Parameter, ValuesValuesA=discontinuity_2.Points)  # -> Keys, ValuesValuesA
sort_list_2 = SortList(Keys=curve_closest_point.Parameter, ValuesValuesA=discontinuity.Points)  # -> Keys, ValuesValuesA
concatenate = Concatenate(FragmentA="WWR", FragmentB=division)
rectangle_2pt_2 = Rectangle2Pt(Plane=PlaneXY(0, 0, 0), PointA=point, PointB=move_3.Geometry, Radius=0)  # -> Rectangle, Length
panel_12 = Panel(division)
polyline = PolyLine(Vertices=sort_list_2.ValuesValuesA, Closed=True)
graft_tree = GraftTree(Tree=sort_list_2.ValuesValuesA, IncludeEmptyLists=True, IncludeNullItems=True)
graft_tree_2 = GraftTree(Tree=sort_list.ValuesValuesA, IncludeEmptyLists=True, IncludeNullItems=True)
text_tag_3d = TextTag3D(Location=move_2.Geometry, Text=concatenate, Size=Slider(0.4, range=0..1), Justification=7)
curve_3 = Curve(rectangle_2pt_2.Rectangle)
region_difference_2 = RegionDifference(CurvesA=offset_curve, CurvesB=curve_3)
region_intersection = RegionIntersection(CurvesA=curve_3, CurvesB=offset_curve)
merge = Merge(Data1=graft_tree_2, Data2=graft_tree)
polyline_2 = PolyLine(Vertices=merge, Closed=False)
curve_4 = Curve(region_intersection)
curve_5 = Curve(region_difference_2)
explode = Explode(Curve=curve_4, Recursive=True)  # -> Segments, Vertices
unit_z_2 = UnitZ(Factor=gene_pool)
area_4 = Area(Geometry=curve_4)  # -> Area, Centroid
extrude = Extrude(Base=explode.Segments, Direction=unit_z_2)
area_5 = Area(Geometry=boundary_surfaces)  # -> Area, Centroid
unit_y = UnitY(Factor=1)
unit_x_2 = UnitX(Factor=1)
boundary_surfaces_4 = BoundarySurfaces(Edges=flatten([offset_curve, curve]))
clean_tree = CleanTree(RemoveNulls=True, RemoveInvalid=True, RemoveEmpty=False, Tree=extrude)
boundary_surfaces_5 = BoundarySurfaces(Edges=curve_4)
boundary_surfaces_6 = BoundarySurfaces(Edges=curve_5)
line_sdl = LineSDL(Start=point, Direction=unit_x_2, Length=1)
line_sdl_2 = LineSDL(Start=point, Direction=unit_y, Length=1)
python_3_script_2 = Python3Script(input_text="san diego, california", run=Toggle(False))  # -> out, points; same code as python_3_script
deconstruct_brep = DeconstructBrep(Brep=boundary_surfaces)  # -> Faces, Edges, Vertices
division_2 = Division(A=area_4.Area, B=area_5.Area)
number_2 = Number(python_3_script_2.points)
custom_preview_3 = CustomPreview(Geometry=boundary_surfaces_5, Material=ColourSwatch(SwatchColor=RGB(120, 241, 255)))
custom_preview_4 = CustomPreview(Geometry=clean_tree, Material=ColourSwatch(SwatchColor=RGB(203, 99, 255)))
custom_preview_5 = CustomPreview(Geometry=boundary_surfaces_6, Material=ColourSwatch(SwatchColor=RGB(255, 255, 255)))
concatenate_2 = Concatenate(FragmentA="WWR", FragmentB=division_2)
panel_13 = Panel(number_2)
custom_preview_6 = CustomPreview(Geometry=boundary_surfaces_4, Material=ColourSwatch(SwatchColor=RGB(145, 140, 140)))
list_item_4 = ListItem(List=deconstruct_brep.Vertices, Index=Slider(2, range=0..10), Wrap=True)
unit_x_3 = UnitX(Factor=1)
move_4 = Move(Geometry=list_item_4, Motion=unit_x_3)  # -> Geometry, Transform
list_item_5 = ListItem(List=gene_pool, Index=Slider(2, range=0..10), Wrap=True)
panel_14 = Panel(concatenate_2)
panel_15 = Panel(list_item_5)
text_tag_3d_2 = TextTag3D(Location=move_4.Geometry, Text=concatenate_2, Size=Slider(0.4, range=0..1), Justification=7)
concatenate_3 = Concatenate(FragmentA="shading depth in meters: ", FragmentB=panel_15)
panel_16 = Panel(panel_14)
panel_17 = Panel(concatenate_3)
python_3_script_3 = Python3Script(city="Istanbul", WWR=flatten(panel_16), shading_depth=flatten(panel_17), run=Toggle(False))  # -> out, answer; inputs city: String, WWR: String
# ---------- python_3_script_3: Python ----------
#r: requests

import requests
from ghpythonlib.treehelpers import list_to_tree

url = 'http://localhost:5000/llm_call'


input_text = f"I have a midrise apartment building in the city of Istanbul. This is the current window properties, it has the WWR (window to wall ratio) and shading depth for shading device above the window: {WWR}, {shading_depth}"

print(input_text)

payload = {'input': input_text}

out = None
if run:
    response = requests.post(url, json=payload)

    if response.status_code == 200:
        data = response.json()
        out = data['response']
    else:
        out = "Failed to connect:"

answer = out
# ---------- end python_3_script_3 ----------
panel_18 = Panel(python_3_script_3.answer)
panel_19 = Panel(python_3_script_3.out)
