# Grasshopper definition llm_requests_windows_EP.gh (Grasshopper 1.0.8)
# plug-ins: Heteroptera, Human UI, Bifocals, ShapeDiverForGrasshopper

shapediver_document_payload = ShapeDiverDocumentPayload({AbsoluteTolerance=0, AngleTolerance=0, DistanceDisplayPrecision=0, GltfVersion="Gltf2", GrasshopperVersion="1.0.0008", InputGroups="{}", OutputGroups="{}", RelativeTolerance=0, RhinoVersion="8.18.25100.11001", UnitSystem=0, VersionCreated="1.26.0.0", VersionSaved="1.26.0.0"})

location = Slider(1, range=1..3)
stretch = Slider(1.3, range=0.2..2.5)

vertical = Slider(0.7, range=0..1)
horizontal = Slider(0.2, range=0..1)

panel = Panel("how do i bake cookies?")  # disabled
python_3_script = Python3Script(input_text=panel, run=Toggle(False))  # -> out, out_2; disabled
# ---------- python_3_script: Python ----------
#r: requests

import requests

url = 'http://localhost:5000/llm_call'
payload = {'input': input_text}


out = None
if run:
    response = requests.post(url, json=payload)

    if response.status_code == 200:
        data = response.json()
        out = data['response']
    else:
        out = "Failed to connect:"

a = out
# ---------- end python_3_script ----------

# ----
# Create Display Window
number_slider = Slider(800, range=0..1000)
launch_window = LaunchWindow(
    Show=Toggle(True),
    Name="Facade Generator",
    Width=Slider(640, range=0..1000),
    Height=number_slider,
    FontFamily="Arial",
    ChildStatus=0,
    EnableHorizScroll=False)

panel_2 = Panel("san diego, california")  # disabled

create_text_box = CreateTextBox(Label="Type desired WWR", DefaultText="0.1", UpdateButton=True, showLabel=True)
create_slider = CreateSlider(Slider=stretch, ShowBounds=False, ShowTicks=False, ShowTooltip=False, ShowValLabel=True, showLabel=True)
create_slider_2 = CreateSlider(Slider=vertical, ShowBounds=False, ShowTicks=False, ShowTooltip=False, ShowValLabel=True, showLabel=True)
create_slider_3 = CreateSlider(Slider=horizontal, ShowBounds=False, ShowTicks=False, ShowTooltip=False, ShowValLabel=True, showLabel=True)
create_label = CreateLabel(LabelText="Window", LabelSize=Slider(15, range=10..50), Justification=Slider(1, range=0..2))
merge = Merge(Data1=create_label, Data2=create_slider, Data3=create_slider_3, Data4=create_slider_2, Data5=create_text_box)
create_stack = CreateStack(UIElements=merge, Horizontal=Toggle(False))
create_border = CreateBorder(
    UIElement=create_stack,
    BorderThickness=Slider(0.1, range=0.1..4),
    BorderColor=RGB(0, 0, 0),
    CornerRadius=Slider(16, range=1..50))

boolean_toggle = BooleanToggle(False)  # disabled
panel_3 = Panel(python_3_script.out_2)  # disabled
python_3_script_2 = Python3Script(input_text=panel_2, run=boolean_toggle)  # -> out, min_range, max_range, description; disabled
# ---------- python_3_script_2: Python ----------
#r: requests

import requests

url = 'http://localhost:5000/llm_call'
payload = {'input': input_text}


out = None
if run:
    response = requests.post(url, json=payload)

    if response.status_code == 200:
        data = response.json()
        out = data['response']
    else:
        out = "Failed to connect:"


print(out)
# ---------- end python_3_script_2 ----------

create_text_box_2 = CreateTextBox(Label="Update Shading Depth in m.", DefaultText="0.1", UpdateButton=True, showLabel=True)
create_slider_4 = CreateSlider(Slider=location, ShowBounds=False, ShowTicks=False, ShowTooltip=False, ShowValLabel=True, showLabel=True)
create_label_2 = CreateLabel(LabelText="Shade", LabelSize=Slider(15, range=10..50), Justification=Slider(1, range=0..2))
merge_2 = Merge(Data1=create_label_2, Data2=create_slider_4, Data3=create_text_box_2)
create_stack_2 = CreateStack(UIElements=merge_2, Horizontal=Toggle(False))
create_border_2 = CreateBorder(
    UIElement=create_stack_2,
    BorderThickness=Slider(0.1, range=0.1..4),
    BorderColor=RGB(0, 0, 0),
    CornerRadius=Slider(16, range=1..50))

panel_4 = Panel(python_3_script_2.description)

value_listener = ValueListener(Elements=create_slider, SomeProperty=True)  # -> Values, Indices
value_listener_2 = ValueListener(Elements=create_slider_3, SomeProperty=True)  # -> Values, Indices
value_listener_3 = ValueListener(Elements=create_slider_2, SomeProperty=True)  # -> Values, Indices
value_listener_4 = ValueListener(Elements=create_text_box, SomeProperty=True)  # -> Values, Indices

panel_5 = Panel(python_3_script_2.out)
panel_6 = Panel(python_3_script_2.max_range)

value_listener_5 = ValueListener(Elements=create_slider_4, SomeProperty=True)  # -> Values, Indices
value_listener_6 = ValueListener(Elements=create_text_box_2, SomeProperty=True)  # -> Values, Indices

panel_7 = Panel(python_3_script_2.min_range)
number_slider_2 = Slider(3, range=0..10)
merge_3 = Merge(Data3=create_border, Data4=create_border_2)
construct_point = ConstructPoint(XCoordinate=Slider(23, range=5..30), YCoordinate=0, ZCoordinate=0)
add_elements = AddElements(Window=launch_window, Elements=flatten(merge_3), DoVLChecking=True)  # -> AddedElements, ElementNames
rectangle = Rectangle(Plane=construct_point, XSize=number_slider_2, YSize=number_slider_2, Radius=0)  # -> Rectangle, Length
curve = Curve(rectangle.Rectangle)
curve_2 = Curve(curve)
boundary_surfaces = BoundarySurfaces(Edges=curve)
area = Area(Geometry=curve_2)  # -> Area, Centroid
offset_curve = OffsetCurve(Curve=boundary_surfaces, Distance=Slider(-0.2, range=-0.2..2), Corners=1)
construct_point_2 = ConstructPoint(XCoordinate=value_listener_2.Values, YCoordinate=value_listener_3.Values, ZCoordinate=0)
multiplication = Multiplication(A=area.Area, B=value_listener_4.Values)
panel_8 = Panel(multiplication)
division = Division(A=multiplication, B=value_listener.Values)
evaluate_surface = EvaluateSurface(Surface=reparameterize(curve), Point=construct_point_2)  # -> Point, Normal, UDirection, VDirection, Frame
point = Point(evaluate_surface.Point)

negative = Negative(Value=division)
negative_2 = Negative(Value=value_listener.Values)
division_2 = Division(A=division, B="2")
division_3 = Division(A=value_listener.Values, B="2")
division_4 = Division(A=negative, B="2")
division_5 = Division(A=negative_2, B="2")
construct_domain = ConstructDomain(DomainStart=division_2, DomainEnd=division_4)
construct_domain_2 = ConstructDomain(DomainStart=division_3, DomainEnd=division_5)
rectangle_2 = Rectangle(Plane=point, XSize=construct_domain_2, YSize=construct_domain, Radius=0)  # -> Rectangle, Length

curve_3 = Curve(rectangle_2.Rectangle)
discontinuity = Discontinuity(Curve=curve_3, Level=1)  # -> Points, Parameters
boundary_surfaces_2 = BoundarySurfaces(Edges=offset_curve)
region_intersection = RegionIntersection(CurvesA=curve_3, CurvesB=curve)
region_difference = RegionDifference(CurvesA=curve, CurvesB=curve_3)
curve_4 = Curve(region_intersection)
pull_point = PullPoint(Point=discontinuity.Points, Geometry=boundary_surfaces_2, ClosestOnly=True)  # -> ClosestPoint, Distance, Index
curve_5 = Curve(region_difference)
explode = Explode(Curve=curve_4, Recursive=True)  # -> Segments, Vertices
unit_z = UnitZ(Factor=value_listener_6.Values)
smaller_than = SmallerThan(FirstNumber=pull_point.Distance, SecondNumber="0.01")  # -> SmallerThan, OrEqualTo
list_item = ListItem(List=explode.Segments, Index=value_listener_5.Values, Wrap=True)
extrude = Extrude(Base=list_item, Direction=unit_z)
panel_9 = Panel(smaller_than.SmallerThan)
boundary_surfaces_3 = BoundarySurfaces(Edges=flatten([curve, boundary_surfaces]))
clean_tree = CleanTree(RemoveNulls=True, RemoveInvalid=True, RemoveEmpty=False, Tree=extrude)
boundary_surfaces_4 = BoundarySurfaces(Edges=curve_5)
boundary_surfaces_5 = BoundarySurfaces(Edges=curve_4)
python_3_script_3 = Python3Script(input_text="san diego, california", run=Toggle(False))  # -> out, points
# ---------- python_3_script_3: Python ----------
#r: requests

import requests
from ghpythonlib.treehelpers import list_to_tree

url = 'http://localhost:5000/llm_call'
payload = {'input': input_text}


out = None
if run:
    response = requests.post(url, json=payload)

    if response.status_code == 200:
        data = response.json()
        out = data['response']
    else:
        out = "Failed to connect:"

try:
    print(out)
    text = out.splitlines()
    point1 = []
    for t in text:
        t = t.replace("[","")
        t = t.replace("]","")
        print(t)
        x, y = t.split(",")
        point1.append([x,y])

    points = list_to_tree(point1)
except Exception as e:
    # simple print
    print("Caught exception:", e)
    print("Incorrect format")
# ---------- end python_3_script_3 ----------
deconstruct_brep = DeconstructBrep(Brep=boundary_surfaces)  # -> Faces, Edges, Vertices
custom_preview = CustomPreview(Geometry=boundary_surfaces_4, Material=ColourSwatch(SwatchColor=RGB(255, 255, 255)))
custom_preview_2 = CustomPreview(Geometry=boundary_surfaces_5, Material=ColourSwatch(SwatchColor=RGB(120, 241, 255)))
custom_preview_3 = CustomPreview(Geometry=clean_tree, Material=ColourSwatch(SwatchColor=RGB(203, 99, 255)))
number = Number(python_3_script_3.points)
custom_preview_4 = CustomPreview(Geometry=boundary_surfaces_3, Material=ColourSwatch(SwatchColor=RGB(145, 140, 140)))
panel_10 = Panel(number)
list_item_2 = ListItem(List=deconstruct_brep.Vertices, Index=Slider(2, range=0..10), Wrap=True)
unit_x = UnitX(Factor=1)
area_2 = Area(Geometry=curve_4)  # -> Area, Centroid
area_3 = Area(Geometry=boundary_surfaces)  # -> Area, Centroid
move = Move(Geometry=list_item_2, Motion=unit_x)  # -> Geometry, Transform
division_6 = Division(A=area_2.Area, B=area_3.Area)
concatenate = Concatenate(FragmentA="WWR", FragmentB=division_6)
text_tag_3d = TextTag3D(Location=move.Geometry, Text=concatenate, Size=Slider(0.4, range=0..1), Justification=7)
list_item_3 = ListItem(Index=Slider(2, range=0..10), Wrap=True)
panel_11 = Panel(concatenate)
panel_12 = Panel(list_item_3)
panel_13 = Panel(division_6)
concatenate_2 = Concatenate(FragmentA="shading depth in meters: ", FragmentB=panel_12)
boolean_toggle_2 = BooleanToggle(False)
panel_14 = Panel(concatenate_2)
panel_15 = Panel(panel_11)
panel_16 = Panel("""Left
Up
Right""")
horizontal_2 = Slider(0.3, range=0..1)
vertical_2 = Slider(0.6, range=0..1)
list_item_4 = ListItem(List=panel_16, Index=Slider(1, range=0..2), Wrap=True)
panel_17 = Panel(list_item_4)
number_slider_3 = Slider(0, range=0..2)
create_slider_5 = CreateSlider(Slider=horizontal_2, ShowBounds=False, ShowTicks=False, ShowTooltip=False, ShowValLabel=True, showLabel=True)
create_slider_6 = CreateSlider(Slider=vertical_2, ShowBounds=False, ShowTicks=False, ShowTooltip=False, ShowValLabel=True, showLabel=True)
create_label_3 = CreateLabel(LabelText="Shade", LabelSize=Slider(15, range=10..50), Justification=Slider(1, range=0..2))
create_label_4 = CreateLabel(LabelText="Window Placement", LabelSize=Slider(15, range=10..50), Justification=Slider(1, range=0..2))
create_label_5 = CreateLabel(LabelSize=Slider(10, range=10..50), Justification=Slider(0, range=0..2))
create_label_6 = CreateLabel(LabelText="Current WWR", LabelSize=Slider(15, range=10..50), Justification=Slider(1, range=0..2))

# ----
# City + Send Button
panel_18 = Panel("Istanbul")
create_text_box_3 = CreateTextBox(Label="Location", DefaultText=panel_18, UpdateButton=invert(True), showLabel=True)
create_button = CreateButton(ButtonName="Send", ButtonStyle=0)
create_stack_3 = CreateStack(UIElements=[create_text_box_3, create_button], Horizontal=True)

# ----
# Material Suggestion
panel_19 = Panel("""Brick
Stone
Metal""")
create_pulldown_menu = CreatePulldownMenu(Label="Material Suggestions", ListItems=panel_19, showLabel=True)

# ----
# Chat - User Message
panel_20 = Panel("[Insert text here]")
create_text_box_4 = CreateTextBox(Label="User Message", DefaultText=panel_20, UpdateButton=invert(True), showLabel=True)
create_button_2 = CreateButton(ButtonName="Send", ButtonStyle=0)
create_stack_4 = CreateStack(UIElements=[create_text_box_4, create_button_2], Horizontal=True)

create_text_box_5 = CreateTextBox(Label="User Message", UpdateButton=invert(True), showLabel=True)
create_button_3 = CreateButton(ButtonName="Send", ButtonStyle=0)

merge_4 = Merge(Data1=create_label_6, Data2=create_label_5)  # -> flatten(Result)
merge_5 = Merge(Data1=create_label_3)
set_slider = SetSlider(UISlider=create_slider_6)
create_text_block = CreateTextBlock(TextSize=12, Justification=2)
create_label_7 = CreateLabel(LabelText="Bot Message", LabelSize=12, Justification=0)
create_stack_5 = CreateStack(UIElements=merge_4, Horizontal=Toggle(False))
create_stack_6 = CreateStack(UIElements=merge_5, Horizontal=Toggle(False))
panel_21 = Panel(create_text_box_5)
create_border_3 = CreateBorder(UIElement=create_text_block, BorderThickness=5, BorderColor=RGB(0, 0, 0), CornerRadius=0)
create_stack_7 = CreateStack(UIElements=[create_text_box_5, create_button_3], Horizontal=True)
create_border_4 = CreateBorder(
    UIElement=create_stack_6,
    BorderThickness=Slider(0.1, range=0.1..4),
    BorderColor=RGB(0, 0, 0),
    CornerRadius=Slider(16, range=1..50))
value_listener_7 = ValueListener(Elements=create_button, SomeProperty=True)  # -> Values, Indices
data_recorder = DataRecorder(value_listener_7.Values, DataLimit=-10, RecordData=True)
merge_6 = Merge(Data1=create_label_4)
value_listener_8 = ValueListener(Elements=create_text_box_3, SomeProperty=True)  # -> Values, Indices
create_border_5 = CreateBorder(
    UIElement=create_stack_5,
    BorderThickness=Slider(0.1, range=0.1..4),
    BorderColor=RGB(0, 0, 0),
    CornerRadius=Slider(16, range=1..50))
launch_window_2 = LaunchWindow(Show=Toggle(False), Name="Control Window", Width=370, Height=400, ChildStatus=0, EnableHorizScroll=False)
value_listener_9 = ValueListener(Elements=create_text_box_5, SomeProperty=True)  # -> Values, Indices
value_listener_10 = ValueListener(Elements=create_button_3, SomeProperty=True)  # -> Values, Indices
panel_22 = Panel(value_listener_10.Values)
panel_23 = Panel(value_listener_8.Values)
stream_freeze_gate = StreamFreezeGate(Data=value_listener_7.Values, PassingSwitch=True)
panel_24 = Panel(stream_freeze_gate)
stream_freeze_gate_2 = StreamFreezeGate(Data=value_listener_8.Values, PassingSwitch=value_listener_7.Values, Freeze=True)
panel_25 = Panel(stream_freeze_gate_2)
python_3_script_4 = Python3Script(city=panel_25, WWR=flatten(panel_15), shading_depth=flatten(panel_14), orientation="south", run=data_recorder)  # -> out, answer, numbers; inputs city: String, WWR: String
# ---------- python_3_script_4: Python ----------
#r: requests

import requests
from ghpythonlib.treehelpers import list_to_tree

url = 'http://localhost:5000/llm_call'

input_text = f"I have a midrise apartment building in the city of {city}. This is the current window properties, it has the WWR (window to wall ratio) and shading depth for shading device above the window: {WWR}, {shading_depth}, {orientation} facing orientation"

print(input_text)

payload = {'input': input_text}

out = None
if run:
    response = requests.post(url, json=payload)

    if response.status_code == 200:
        data = response.json()
        out = data['response']
    else:
        out = "Failed to connect:"

answer = out

try:
    print(out)
    text = out.splitlines()
    numbers = [] 
    for i,t in enumerate(text): 
        if i <2: 
            number = t.split(":")[1] 
            numbers.append(number)
            print(number)
except Exception as e:
    # simple print
    print("Caught exception:", e)
    print("Incorrect format")
# ---------- end python_3_script_4 ----------
panel_26 = Panel(python_3_script_4.answer)
panel_27 = Panel(python_3_script_4.out)
panel_28 = Panel(python_3_script_4.numbers)
list_item_5 = ListItem(List=panel_28, Index=0, Wrap=True)  # -> Item, Item1
wwr = Panel(list_item_5.Item)
shading_depth_in_m = Panel(list_item_5.Item1)
create_stack_8 = CreateStack(UIElements=merge_6, Horizontal=Toggle(False))
panel_29 = Panel(value_listener_9.Values)
add_elements_2 = AddElements(Window=launch_window_2, Elements=flatten([create_stack_7, create_label_7, create_text_block]), DoVLChecking=True)  # -> AddedElements, ElementNames
stream_freeze_gate_3 = StreamFreezeGate(Data=value_listener_9.Values, PassingSwitch=value_listener_10.Values, Freeze=True)
set_textblock_contents = SetTextBlockContents(TextBlockToModify=create_text_block, NewTextBlockContents="ABC")
create_border_6 = CreateBorder(
    UIElement=create_stack_8,
    BorderThickness=Slider(0.1, range=0.1..4),
    BorderColor=RGB(0, 0, 0),
    CornerRadius=Slider(16, range=1..50))
panel_31 = Panel(value_listener_7.Values)
panel_32 = Panel(stream_freeze_gate_2)
panel_33 = Panel(stream_freeze_gate_3)
merge_7 = Merge(
    Data1=create_border_6,
    Data3=create_stack_3,
    Data5=create_pulldown_menu,
    Data7=create_border_5,
    Data8=create_border_6,
    Data9=create_border_4)
merge_8 = Merge(Data1=create_border_6, Data2=create_border_4, Data3=create_border_5)
add_elements_3 = AddElements(Elements=flatten(merge_8), DoVLChecking=True)  # -> AddedElements, ElementNames; disabled
panel_34 = Panel("What is the WWR window to wall ratio for a north facing facade building located in Istambul")
surface = Surface(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)
area_4 = Area(Geometry=surface)  # -> Area, Centroid
boolean_toggle_3 = BooleanToggle(True)
python_3_script_5 = Python3Script(input_area=area_4.Area, run=boolean_toggle_3)  # -> out, out_2; inputs input_area: Double
# ---------- python_3_script_5: Python ----------
# requirements: requests


import requests

url = 'http://localhost:5000/get_from_grasshopper'
payload = {'input': str(input_area)}


out = None
if run:
    response = requests.post(url, json=payload)

    if response.status_code == 200:
        out = "Data was sent to AI Assistant"
    else:
        out = "Failed to connect:"

a = out
# ---------- end python_3_script_5 ----------
python_3_script_6 = Python3Script(run=boolean_toggle_3)  # -> out, a
# ---------- python_3_script_6: Python ----------
# requirements: requests
import requests

# Define the URL for the Flask server endpoint
url = 'http://127.0.0.1:5000/send_to_grasshopper'

# Initialize the output variable
concept_text = 'Has not been generated yet'

# Check if the script should run
if run:
    try:
        # Send a GET request to the Flask server to fetch the data
        response = requests.get(url)

        # Check the response status code
        if response.status_code == 200:
            concept_text = response.json()
            print(f"Received concept: {concept_text}")
        else:
            out = f"Failed to connect: {response.status_code}"
    except Exception as e:
        out = f"Error: {e}"

# Assign the output to a variable for Grasshopper
a = concept_text
# ---------- end python_3_script_6 ----------
python_3_script_7 = Python3Script(input_text=panel_34, run=Toggle(True))  # -> out, out_2
# ---------- python_3_script_7: Python ----------
# requirements: requests


import requests

url = 'http://localhost:5000/llm_call'
payload = {'input': input_text}


out = None
if run:
    response = requests.post(url, json=payload)

    if response.status_code == 200:
        data = response.json()
        out = data['response']
    else:
        out = "Failed to connect:"

a = out
# ---------- end python_3_script_7 ----------
panel_35 = Panel(python_3_script_6.a)
panel_36 = Panel(python_3_script_5.out_2)
panel_37 = Panel(python_3_script_7.out_2)

# ----
# Bot - City
panel_38 = Panel("")
create_text_block_2 = CreateTextBlock(Text=panel_38, TextSize=12, Justification=number_slider_3)
create_label_8 = CreateLabel(LabelText="Bot Message", LabelSize=12, Justification=number_slider_3)
panel_39 = Panel(panel_26)
set_textblock_contents_2 = SetTextBlockContents(TextBlockToModify=create_text_block_2, NewTextBlockContents=panel_39)

create_scroll_viewer = CreateScrollViewer(
    UIElements=create_text_block_2,
    HorizontalScrollBarVisibility=0,
    VerticalScrollBarVisibility=0,
    Width=Slider(830, range=0..1000),
    Height=Slider(275, range=0..1000))

create_stack_9 = CreateStack(UIElements=[create_label_8, create_scroll_viewer], Horizontal=Toggle(False))
